# Grasshopper definition generetor.gh (Grasshopper 1.0.7)
# Copyright: 2021
# Copyright: 2024-02-51
# Copyright: 2024-02-20
# plug-ins: Swiftlet, Linkajou, ImageClipboard, Speckle 2, ShapeDiverForGrasshopper

sddp = ShapeDiverDocumentPayload({AbsoluteTolerance=0, AngleTolerance=0, DistanceDisplayPrecision=0, GltfVersion="Gltf2", GrasshopperVersion="1.0.0007", InputGroups="{}", OutputGroups="{}", RelativeTolerance=0, RhinoVersion="7.36.23346.16351", UnitSystem=0, VersionCreated="1.17.0.0", VersionSaved="1.17.0.0"})
clipboardimage = ClipboardImage(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)
panel = Panel("https://speckle.xyz/streams/f8fdca34e8/branches/base%20design")
input_image = InputImage(clipboardimage)
vp = Viewports({"Perspective": "9e190d36-c6d3-4f8f-92b6-76752c235cc6", "Top": "780c8bbe-75e2-4a93-aa03-99e4d89b1d72", "Front": "adb182a7-dbe0-44ee-b1e3-8cd5217d461e", "Right": "16498311-cc8b-4b60-a054-ef36c6de9fbb"}, selected="Perspective")
ghpython_script = GhPythonScript(x=input_image)  # -> a
# ---------- ghpython_script: Python ----------
__author__ = "mm1062"
__version__ = "2024.03.02"

import rhinoscriptsyntax as rs


a = x.Keys
a = x["image"]
# ---------- end ghpython_script ----------
panel_2 = Panel("Please write a multi paragraph introduction to an architectural report on the basis of the following image.")
beta_get_viewport_image = BETAGetViewportImage(ViewportID=vp)  # -> Image, ZDepth, Size
cluster = Cluster_2(fragment_b="Whats on the image")
ghpython_script_2 = GhPythonScript(x=ghpython_script)  # -> a
# ---------- ghpython_script_2: Python ----------
__author__ = "mm1062"
__version__ = "2024.03.02"

import rhinoscriptsyntax as rs
from System import Convert
from System.IO import MemoryStream, Stream
from System.Drawing import Bitmap, Size
from System.Drawing.Imaging import ImageFormat

x = Bitmap(x, Size(100,100))


empty = ""
memoryStream = MemoryStream();
x.Save(memoryStream, ImageFormat.Png);
memoryStream.Position = 0L;
array = memoryStream.ToArray();
memoryStream.Close();
a = Convert.ToBase64String(array);
# ---------- end ghpython_script_2 ----------
receive = Receive(
    Stream="https://speckle.xyz/streams/f8fdca34e8/commits/87b8c5736a",
    AutoReceive=False,
    CurrentComponentState="expired",
    ExpandOutput=True,
    LastInfoMessage="Povl Filip Sonne-Frederiksen @ 08/01/2023 10:05:21: Sent 1 elements from Rhino. (id:87b8c5736a)",
    ReceiveOnOpen=False,
    ReceivedCommitId="87b8c5736a",
    StreamWrapper="https://speckle.xyz/streams/f8fdca34e8/commits/87b8c5736a",
    selectedKitName="Objects")  # -> Info, CollectionType, Elements, Name, SpeckleType
cluster_2 = Cluster_3(fragment_b=ghpython_script_2, fragment_b_2=panel_2)
data_dam = DataDam(DataA=beta_get_viewport_image.Image, BufferDelay=10000000, BufferMode=0)
clipboardimage_2 = ClipboardImage(beta_get_viewport_image.Image)
receive_2 = Receive(
    Stream=panel,
    AutoReceive=False,
    CurrentComponentState="expired",
    ExpandOutput=True,
    LastInfoMessage="Povl Filip Sonne-Frederiksen @ 08/01/2023 10:04:33: Sent 64 elements from Rhino. (id:415b381d6c)",
    ReceiveOnOpen=False,
    ReceivedCommitId="415b381d6c",
    StreamWrapper="https://speckle.xyz/streams/f8fdca34e8/branches/base design",
    selectedKitName="Objects")  # -> Info, CollectionType, Elements, Name, SpeckleType
post_request = POSTRequest(URL="http://localhost:3000/generate/", Body=cluster_2)  # -> Status, Content, Response; disabled
data_recorder = DataRecorder(data_dam, DataLimit=-10, RecordData=True)
deconstruct_speckle_object = DeconstructSpeckleObject(SpeckleObject=receive.Elements, selectedKitName="Objects")  # -> CollectionType, DisplayStyle, Elements, Name, SpeckleType, Visible
cluster_3 = Cluster(text=post_request.Content)
stream_details = StreamDetails(Stream=panel)  # -> StreamID, Name, Description, CreatedAt, UpdatedAt, Public, Collaborators, Branches
list_item = ListItem(List=data_recorder, Index=0, Wrap=True)
deconstruct_speckle_object_2 = DeconstructSpeckleObject(SpeckleObject=receive_2.Elements, selectedKitName="None")  # -> CollectionType, DisplayStyle, Elements, Name, SpeckleType, Visible
account_details = AccountDetails(SpeckleAccount=stream_details.Collaborators)  # -> IsDefault, ServerName, ServerCompany, ServerURL, UserID, UserName, UserCompany, UserEmail
panel_3 = Panel("Lorem ipsum dolor sit amet, consectetur adipiscing elit, sed do eiusmod tempor incididunt ut labore et dolore magna aliqua. Eget nullam non nisi est. Lectus nulla at volutpat diam ut. Id nibh tortor id aliquet lectus proin nibh nisl condimentum. Egestas integer eget aliquet nibh praesent. Duis at consectetur lorem donec massa sapien. Accumsan tortor posuere ac ut consequat semper viverra nam. Tincidunt tortor aliquam nulla facilisi cras fermentum odio eu feugiat. Fermentum leo vel orci porta non pulvinar. Egestas sed sed risus pretium. Laoreet id donec ultrices tincidunt. Etiam dignissim diam quis enim lobortis. Ut porttitor leo a diam. Eget nunc scelerisque viverra mauris in aliquam. Est lorem ipsum dolor sit amet consectetur. Ornare suspendisse sed nisi lacus sed viverra tellus in. Ac turpis egestas integer eget. Felis donec et odio pellentesque diam volutpat commodo sed egestas. Urna neque viverra justo nec ultrices. Blandit turpis cursus in hac habitasse.")
speckle_object_value_by_key = SpeckleObjectValueByKey(Object=receive_2.Elements, Key="name", selectedKitName="Objects")  # -> graft(Value)
speckle_object_value_by_key_2 = SpeckleObjectValueByKey(Object=receive_2.Elements, Key="id", selectedKitName="Objects")  # -> graft(Value)
cluster_4 = Cluster_6(object=deconstruct_speckle_object_2.Elements)  # -> header, text, value, value_2
cluster_5 = Cluster_4(stream=panel)  # -> name, description, updated_at, person, company, stream_id
table_maker = GhPythonScript(Header=cluster_4.header, col1=cluster_4.text, col2=cluster_4.value, col3=cluster_4.value_2)  # -> text_out; inputs Header: list, col1: tree, col2: tree, col3: tree
# ---------- table_maker: Python ----------
__author__ = "mm1062"
__version__ = "2024.03.03"

import rhinoscriptsyntax as rs
import ghpythonlib.treehelpers as th

text_out = []


for col1, col2 , col3 in zip(col1.Branches, col2.Branches, col3.Branches):
    text = ""
    text += "| " + Header[0] + " | " + Header[1] + " | " + Header[2] + " |\n"
    text += "| ----------- | ----------- |----------- |\n"
    
    for val1, val2, val3 in zip(col1, col2, col3):
        #text += "| " + val1 + " | " + val2 + " | " + val3 + " |\n"
        text += '| {} | {:0.2f} | {:0.2f} | \n'.format(val1, float(val2), float(val3))

    text_out.append(text)
    
text_out = th.list_to_tree([[l] for l in text_out])
# ---------- end table_maker ----------
header = GhPythonScript(
    Title=cluster_5.name,
    Description=cluster_5.description,
    Date=cluster_5.updated_at,
    PersonName=cluster_5.person,
    Company=cluster_5.company,
    streamID=cluster_5.stream_id)  # -> flatten(text_out)
# ---------- header: Python ----------
__author__ = "mm1062"
__version__ = "2024.03.02"

import rhinoscriptsyntax as rs
import ghpythonlib.treehelpers as th
import scriptcontext as sc

text_out = ""

def add_header(text):
    global text_out
    text_out += '---\n'
    text_out += 'title: '+text+'\n'
    text_out += 'jupyter:\n'
    text_out += '  nbformat: 4\n'
    text_out += '  nbformat_minor: 5\n'
    text_out += '  kernelspec:\n'
    text_out += '     display_name: Python 2\n'
    text_out += '     language: python\n'
    text_out += '     name: python2\n'
    text_out += '  language_info:\n'
    text_out += '     codemirror_mode:\n'
    text_out += '       name: ipython\n'
    text_out += '       version: 2\n'
    text_out += '     file_extension: ".py"\n'
    text_out += '     mimetype: "text/x-python"\n'
    text_out += '     name: "python"\n'
    text_out += '     nbconvert_exporter: "python"\n'
    text_out += '     pygments_lexer: "ipython2"\n'
    text_out += '     version: "2.7.15"\n'
    text_out += '---\n'

def add_import():
    global text_out
    text_out += """
```code
%pip install specklepy
%pip install pandas
from specklepy.objects import Base
from specklepy.api.client import SpeckleClient
from specklepy.api.wrapper import StreamWrapper
from specklepy.api.credentials import get_default_account
from specklepy.transports.server import ServerTransport
from specklepy.api import operations
import pandas as pd
```


```code
wrapper = StreamWrapper("https://speckle.xyz/streams/f8fdca34e8/commits/415b381d6c")
client = wrapper.get_client("743d2df1ec7e610a0a3adb9b2167414542c18ca328")
transport = wrapper.get_transport()
```


```code
def get_data_frame(base:Base):
    id = []
    name = []
    volume = []
    area = []

    for e in base.elements:
        id.append(e.id)
        name.append(e.speckleType.split(".")[-1])
        volume.append(e.volume)
        area.append(e.area)

    data = {
        "id" : id,
        "Name" : name,
        "Volume" : volume,
        "Area" : area
    }

    return pd.DataFrame(data=data)
```

"""

def add_title(title, desc, date, pers, comp, id):
    global text_out
    text_out += "# " + title + "\n"
    text_out += "__"+pers+"__ *(" + date +")*\n"
    text_out += "\n"
    text_out += ""+comp+"\n"
    text_out += "\n"
    text_out += desc + "\n"
    text_out += "\n"



# Generate Report

add_header(Title)

add_import()

add_title(Title, Description, Date, PersonName, Company, streamID)
# ---------- end header ----------
reportenetor = GhPythonScript(Introduction=panel_3, streamID=cluster_5.stream_id)  # -> flatten(text_out)
# ---------- reportenetor: Python ----------
__author__ = "mm1062"
__version__ = "2024.03.02"

import rhinoscriptsyntax as rs
import ghpythonlib.treehelpers as th
import scriptcontext as sc

text_out = ""


def add_introduction(text, hash = ""):
    global text_out
    text_out += "## Report"
    text_out += "\n"
    text_out += "\n"
    text_out += '<div id="TwoCol" style="display: flex;">\n'
    text_out += '<div id="col1" style="flex: 1;">\n'
    text_out += '<iframe id="iframe"\n'
    text_out += 'src="https://speckle.xyz/embed?stream=f8fdca34e8&commit=415b381d6c&overlay=87b8c5736a&transparent=true&amp;autoload=true&amp;hidecontrols=true&amp;hidesidebar=true"\n'
    text_out += 'width="600" height="400" frameborder="0">\n'
    text_out += '</iframe>\n'
    text_out += '</div>\n'
    text_out += '<div id="col2" style="flex: 1">\n'
    text_out += '<h4>Content</h4>\n'
    text_out += '<p>' + text + '\n'
    text_out += '</p>\n'
    text_out += '</div>\n'
    text_out += '</div>\n'
    text_out += "\n"
    text_out += "\n"


# Generate Report

add_introduction(Introduction)
# ---------- end reportenetor ----------
add_subsection = GhPythonScript(streamID=cluster_5.stream_id, names=speckle_object_value_by_key, objects=speckle_object_value_by_key_2, text=table_maker)  # -> text_out; inputs names: tree, objects: tree, text: tree
# ---------- add_subsection: Python ----------
__author__ = "mm1062"
__version__ = "2024.03.02"

import rhinoscriptsyntax as rs
import ghpythonlib.treehelpers as th
import scriptcontext as sc

text_out = ""


def add_sub_title(text):
    global text_out
    text_out += "### " + text + "\n"
    text_out += "\n"

def add_text_block(text):
    global text_out
    text_out += text + "\n"
    text_out += "\n"

def add_speckle_ifram(objects, stream):
    global text_out
    
    text_out += '<iframe '
    text_out += 'src="https://speckle.xyz/embed?stream=' + stream 
    text_out += '&object=' + objects[0]
    
    if len(objects) > 1:
        text_out += '&overlay='
        
        sub_list = objects[1:] # Remaining items
        for idx, obj in enumerate(sub_list):
            text_out += obj
            if idx != len(sub_list)-1:
                text_out += "%2C"
        
    text_out += '&transparent=true'
    text_out += '&autoload=true'
    text_out += '&hidecontrols=true'
    text_out += '&hidesidebar=true" '
    text_out += 'width="600" height="400"'
    text_out += 'frameborder="0"'
    text_out += '></iframe>\n'
    text_out += "\n"


def add_pandas(hash):
    global text_out
    text_out += """

```code
"""
    text_out += "get_data_frame(operations.receive(obj_id='" + hash + "', remote_transport=transport))"
    text_out += """
```

"""



# Generate Report


for name, objs, text in zip(names.Branches,objects.Branches,text.Branches):
    add_sub_title(name[0])
    add_speckle_ifram(objs, streamID)
    add_text_block(text[0])
    add_pandas(objs[0])
# ---------- end add_subsection ----------
merge = Merge(Data1=header, Data2=reportenetor, Data3=add_subsection)  # -> flatten(Result)
panel_4 = Panel(add_subsection)
text_join = TextJoin(Text=merge)
file_path = FilePath("\\wsl.localhost\Arch\home\mephisto\repos\report+\generated.md")
write_file = GhPythonScript(path=file_path, text=text_join, save=Button())  # inputs save: Boolean
# ---------- write_file: Python ----------
__author__ = "mm1062"
__version__ = "2024.03.02"
        
import rhinoscriptsyntax as rs
import os
import sys

        
if save and path is not None and text is not None:
    with open(path, "w") as file:
        file.write(text)
# ---------- end write_file ----------
panel_5 = Panel(text_join)

# ==== cluster Cluster
text = ClusterInput()
parse_json_string = ParseJSONString(Text=text)
null_item = NullItem(Item=text)  # -> NullFlags, InvalidFlags, Description
read_json_array = ReadJSONArray(Array=parse_json_string)
read_json_object = ReadJSONObject(JObject=read_json_array)  # -> Keys, JTokens
stringify_json_token = StringifyJSONToken(JToken=read_json_object.JTokens)
text_2 = Text(stringify_json_token)
pick_n_choose = PickNChoose(Pattern=null_item.NullFlags, Stream0=text_2, Stream1=" ")
result = ClusterOutput(pick_n_choose)

# ==== cluster Cluster_2
fragment_b = ClusterInput()
concatenate = Concatenate(Fragment_A="'", Fragment_B=fragment_b, A="'")
parse_json_string = ParseJSONString(Text=concatenate)
create_json_object = CreateJSONObject(Keys="text", Values=parse_json_string)
create_json_array = CreateJSONArray(JTokens=create_json_object)
create_json_object_2 = CreateJSONObject(Keys="parts", Values=create_json_array)
create_text_body = CreateTextBody(
    Content=create_json_object_2,
    IsHtmlChecked=False,
    IsJavascriptChecked=False,
    IsJsonChecked=True,
    IsTextChecked=False,
    IsXmlChecked=False)
body = ClusterOutput(create_text_body)

# ==== cluster Cluster_3
fragment_b = ClusterInput()
fragment_b_2 = ClusterInput()
concatenate = Concatenate(Fragment_A="'", Fragment_B=fragment_b, A="'")
parse_json_string = ParseJSONString(Text="'image/png'")
parse_json_string_2 = ParseJSONString(Text=concatenate)
merge = Merge(Data1="mime_type", Data2="data")
concatenate_2 = Concatenate(Fragment_A="'", Fragment_B=fragment_b_2, A="'")
merge_2 = Merge(Data1=parse_json_string, Data2=parse_json_string_2)
create_json_object = CreateJSONObject(Keys="data", Values=parse_json_string_2)
create_json_object_2 = CreateJSONObject(Keys=merge, Values=merge_2)
parse_json_string_3 = ParseJSONString(Text=concatenate_2)
create_json_object_3 = CreateJSONObject(Keys="inline_data", Values=create_json_object_2)
create_json_object_4 = CreateJSONObject(Keys="text", Values=parse_json_string_3)
create_json_array = CreateJSONArray(JTokens=[create_json_object_3, create_json_object_4])
# fetch('http://localhost:3000/generate/', {
# 	method: 'POST',
# 	body: JSON.stringify({
# 		parts: [
# 			// {
# 			//     inline_data: {
# 			//         mime_type: 'image/png',
# 			//         data: 'MMtsdWMBaE2+8oBAucRX9mEXaRNW0MBGD7vKlrp6vRxsZ8lVvnrbNpf0gIqnwRyyQgIGVibUMEL6M4Wl8fP36UUBJFEgIcZ4drw4lNgRBFMVJKOPX',
# 			//     },
# 			// },
# 			{ text: 'What is the weather today?' },
# 		],
# 		completed: false,
# 	}),
# 	headers: {
# 		'Content-type': 'application/json; charset=UTF-8',
# 	},
# })
# 	.then((response) => response.json())
# 	.then((json) => console.log(json));
create_json_object_5 = CreateJSONObject(Keys="parts", Values=create_json_array)
create_text_body = CreateTextBody(
    Content=create_json_object_5,
    IsHtmlChecked=False,
    IsJavascriptChecked=False,
    IsJsonChecked=True,
    IsTextChecked=False,
    IsXmlChecked=False)
body = ClusterOutput(create_text_body)

# ==== cluster Cluster_4
stream = ClusterInput()
stream_details = StreamDetails(Stream=stream)  # -> StreamID, Name, Description, CreatedAt, UpdatedAt, Public, Collaborators, Branches
name = ClusterOutput(stream_details.Name)
description = ClusterOutput(stream_details.Description)
updated_at = ClusterOutput(stream_details.UpdatedAt)
account_details = AccountDetails(SpeckleAccount=stream_details.Collaborators)  # -> IsDefault, ServerName, ServerCompany, ServerURL, UserID, UserName, UserCompany, UserEmail
list_item = ListItem(List=account_details.UserName, Index=0, Wrap=True)
list_item_2 = ListItem(List=account_details.UserCompany, Index=0, Wrap=True)
stream_id = ClusterOutput(stream_details.StreamID)
person = ClusterOutput(list_item)
company = ClusterOutput(list_item_2)

# ==== cluster Cluster_6
object = ClusterInput()
speckle_object_value_by_key = SpeckleObjectValueByKey(Object=object, Key="speckleType", selectedKitName="Objects")
speckle_object_value_by_key_2 = SpeckleObjectValueByKey(Object=object, Key="area", selectedKitName="Objects")
speckle_object_value_by_key_3 = SpeckleObjectValueByKey(Object=object, Key="volume", selectedKitName="Objects")
value = ClusterOutput(speckle_object_value_by_key_2)
value_2 = ClusterOutput(speckle_object_value_by_key_3)
merge = Merge(Data1="speckleType", Data2="area", Data3="volume")
cluster = Cluster_5(text=speckle_object_value_by_key)
header = ClusterOutput(merge)
text = ClusterOutput(cluster)

# ==== cluster Cluster_5
text = ClusterInput()
text_split = TextSplit(Text=text, Separators=".")
list_item = ListItem(List=text_split, Index=0, Wrap=True)  # -> Item1, Item
trim_tree = TrimTree(Tree=list_item.Item1, Depth=1)  # -> simplify(Tree)
trim_tree_2 = TrimTree(Tree=list_item.Item1, Depth=1)  # -> simplify(graft(Tree))
list_length = ListLength(List=trim_tree)
series = Series(Start=1, Step=1, Count=list_length)  # -> simplify(graft(Series))
merge = Merge(Data1=trim_tree_2, Data2=series)
text_join = TextJoin(Text=merge, Join="_")
trim_tree_3 = TrimTree(Tree=text_join, Depth=1)  # -> simplify(Tree)
text_2 = Text(trim_tree_3)
text_3 = ClusterOutput(text_2)
